# Dynamo graph 1.3.4_CopyLinkFiles.dyn (Dynamo 1.3.4.6666)

python_script = Python()
# ---------- python_script.python (53 lines) ----------
# dynamo version - 1.3.0 

import clr,sys
clr.AddReference("RevitAPI")
clr.AddReference("RevitServices")

from Autodesk.Revit.DB import *
from RevitServices.Persistence import DocumentManager

pyt_path = r'C:\Program Files (x86)\IronPython 2.7\Lib';
sys.path.append(pyt_path);

import shutil,os

doc = DocumentManager.Instance.CurrentDBDocument;
link_docs = FilteredElementCollector(doc).OfClass(RevitLinkInstance);


# destination path
docPath = doc.PathName
docName = os.path.basename(docPath).split(".")[0]
dirName = os.path.dirname(docPath)
folder = docName + "LinkFiles"
destFolder = os.path.join(dirName,folder)

if not os.path.exists(destFolder):
	os.mkdir(destFolder)


# collect filepaths 
filepaths = []
for i in link_docs:
	ldoc = i.GetLinkDocument()
	if ldoc:
		lpath = ldoc.PathName
		if lpath not in filepaths:
			filepaths.append(lpath);
			
# new filepaths and remove existing
newfiles = []
for path in filepaths:
	newpath = os.path.join(destFolder, os.path.basename(path))
	newfiles.append(newpath)
	if os.path.exists(newpath):
		os.remove(newpath)

# copy files
output = []
for path in filepaths:
	shutil.copy(path, destFolder);


OUT = newfiles
# ----------------------------------------
