# Dynamo graph center-room.dyn (Dynamo 1.3.2.2480)

categories = Categories("Rooms")
all_elements_of_category = ElementsOfCategory(categories)
python_script = Python(IN[0]=all_elements_of_category)
# ---------- python_script.python (28 lines) ----------
# import common language runtime 
import clr

# load RevitAPI.dll and RevitServices.dll
clr.AddReference("RevitAPI")
clr.AddReference("RevitServices")

# import all classes from Revit DB
from Autodesk.Revit.DB import *

# import document manager
from RevitServices.Persistence import DocumentManager
# import transaction manager
from RevitServices.Transactions import TransactionManager

# instantiate current document
doc = DocumentManager.Instance.CurrentDBDocument

res = []

for i in UnwrapElement(IN[0]):
	point = i.Location.Point
	x = point.X
	y = point.Y
	z = point.Z
	res.append([x*304.8,y*304.8,z*304.8])

OUT = res
# ----------------------------------------
geometry = Element.Geometry(all_elements_of_category)
centroid = Solid.Centroid(geometry)
ZAxis = Vector.ZAxis()
Z = Point.Z(centroid)
code_block = CodeBlock(x=Z) { x>1 ? -x: x; }
translate = Geometry.Translate(geometry=centroid, direction=ZAxis, distance=code_block)
