# Dynamo graph intersect.dyn (Dynamo 1.3.2.2480)

categories = Categories("Walls")
all_elements_of_category = ElementsOfCategory(categories)
geometry = Element.Geometry(all_elements_of_category)
flatten = Flatten(geometry)
categories_2 = Categories("PipeCurves")
all_elements_of_category_2 = ElementsOfCategory(categories_2)
geometry_2 = Element.Geometry(all_elements_of_category_2)
flatten_2 = Flatten(geometry_2)

# group: Place Dummy Family
family_types = FamilyTypes("Family1:Family1")
python_script = Python(IN[0]=flatten, IN[1]=flatten_2)  # frozen
# ---------- python_script.python (15 lines) ----------
import clr
clr.AddReference('ProtoGeometry')
from Autodesk.DesignScript.Geometry import *

walls = IN[0]
pipes = IN[1]
intersections = []

for wall in walls:
	for pipe in pipes:
		intersect = Geometry.Intersect(wall, pipe)
		if intersect:
			intersections.append(intersect)

OUT = intersections
# ----------------------------------------
flatten_3 = Flatten(python_script)
centroid = Solid.Centroid(flatten_3)
byPoint = FamilyInstance.ByPoint(familyType=family_types, point=centroid)

getIntersectionGeometry = Python(IN[0]=all_elements_of_category, IN[1]=all_elements_of_category_2)  # frozen
# ---------- getIntersectionGeometry.python (54 lines) ----------
import clr
clr.AddReference('ProtoGeometry')
clr.AddReference('RevitNodes')
clr.AddReference('RevitAPI')

import Revit
clr.ImportExtensions(Revit.Elements)
clr.ImportExtensions(Revit.GeometryConversion)

from Autodesk.DesignScript.Geometry import *
from Autodesk.Revit.DB import *

elems = UnwrapElement(IN[0])
others = UnwrapElement(IN[1])

others_geometries = []
elems_geometries = []
intersects_geometries = []


def dyn_geo(e):
	# get geo-objects of the element
	geoelem = e.GetGeometryObjectFromReference(Reference(e))
	# get enumerator to loop geo-objects
	geoobj = geoelem.GetEnumerator()
	# loop geo-objector
	for obj in geoobj:
		# convert to dynamo type
		geo = obj.ToProtoType()
	# return geometry
	return geo
# elems loop
for elem in elems:
	# convert dyn-geo, append to geo list
	elems_geometries.append(dyn_geo(elem))
	
# other elems loop
for other in others:
	# convert dyn-geo, append to geo list
	others_geometries.append(dyn_geo(other))

# to collect intersets
# loop elems geo
for elem_geo in elems_geometries:
	# loop others geo
	for other_geo in others_geometries:
		# find intersect geo
		intersect = Geometry.Intersect(elem_geo, other_geo)
		# if intersection occur
		if intersect:
			# append intersection geometry 
			intersects_geometries.append(intersect)

OUT = intersects_geometries
# ----------------------------------------
python_script_2 = Python(IN[0]=all_elements_of_category, IN[1]=all_elements_of_category_2)
# ---------- python_script_2.python (49 lines) ----------
import clr
clr.AddReference('ProtoGeometry')
clr.AddReference('RevitNodes')
clr.AddReference('RevitAPI')

import Revit
clr.ImportExtensions(Revit.Elements)
clr.ImportExtensions(Revit.GeometryConversion)

from Autodesk.DesignScript.Geometry import *
from Autodesk.Revit.DB import *

elems = UnwrapElement(IN[0])
others = UnwrapElement(IN[1])


intersects_geometries = []
centroids = []
sizes = []

def dyn_geo(e):
	# get geo-objects of the element
	geoelem = e.GetGeometryObjectFromReference(Reference(e))
	# get enumerator to loop geo-objects
	geoobj = geoelem.GetEnumerator()
	# loop geo-objector
	for obj in geoobj:
		# convert to dynamo type
		geo = obj.ToProtoType()
	# return geometry
	return geo

# to collect intersets
# loop elems
for elem in elems:
	# loop others
	for other in others:
		# find intersect geo
		elem_geo = dyn_geo(elem)
		other_geo = dyn_geo(other)
		intersect = Geometry.Intersect(elem_geo, other_geo)
		# if intersection occur
		if intersect:
			# append intersection geometry 
			intersects_geometries.append(intersect)
			# pipe diameter 
			sizes(elem.LookupParameter("Diameter").AsDobule())

OUT = intersects_geometries, centroids, sizes
# ----------------------------------------
