# Dynamo graph rebar.dyn (Dynamo 1.3.2.2480)

code_block = CodeBlock()
# ---------- code_block.designscript (3 lines) ----------
{"Rebar Cover - Top Face",
"Rebar Cover - Bottom Face",
"Rebar Cover - Other Faces"};
# ----------------------------------------
select_model_element = DSModelElementSelection()  # 1 picked in the model
python_script = Python()
# ---------- python_script.python (21 lines) ----------
import clr

clr.AddReference('RevitAPI')
clr.AddReference("RevitServices")

from Autodesk.Revit.DB import *
from Autodesk.Revit.DB.Structure import *

from RevitServices.Persistence import DocumentManager
from RevitServices.Transactions import TransactionManager

doc = DocumentManager.Instance.CurrentDBDocument

TransactionManager.Instance.EnsureInTransaction(doc)

newtype = RebarCoverType.Create(doc,"NewType1", 20/304.8)

TransactionManager.Instance.TransactionTaskDone()


OUT = newtype
# ----------------------------------------
setParameterByName = Element.SetParameterByName(element=select_model_element, value=python_script)  # unwired: parameterName
map = List.Map(list=code_block, f_x=setParameterByName)
